% Simulink data dictionary data_params.sldd

Constant = struct(T_moon_K=200, angle_sun_deg=88.5, solar_constant_W_m2=1361)
Spec = struct(alpha_rad=0, epsilon_rad=0.11, alpha_mli=0, epsilon_mli=0)
Area = struct(front=0, back=0, top=0, bottom=0, left=0, right=0, rad=0.5)